# Grasshopper definition mesh.gh (Grasshopper 1.0.7)

nurbs = NurbsCurve(Vertices=[<geometry referenced from the Rhino model> x4], Degree=3, Periodic=False)  # -> Curve, Length, Domain
nurbs_2 = NurbsCurve(Vertices=[<geometry referenced from the Rhino model> x4], Degree=3, Periodic=False)  # -> Curve, Length, Domain
nurbs_3 = NurbsCurve(Vertices=[<geometry referenced from the Rhino model> x4], Degree=3, Periodic=False)  # -> Curve, Length, Domain
loft = Loft(
    Curves=[nurbs_3.Curve, nurbs.Curve, nurbs_2.Curve],
    Options={Adjust=False, Closed=False, LoftEnds=0, LoftSimp=0, LoftType=0, Rebuild=10, Refit=0.01})

srf4pt = _4PointSurface(
    CornerA=<geometry referenced from the Rhino model>,
    CornerB=<geometry referenced from the Rhino model>,
    CornerC=<geometry referenced from the Rhino model>,
    CornerD=<geometry referenced from the Rhino model>)
project = Project(Curve=loft, Brep=srf4pt, Direction=Vector(0, 0, 1))
mesh = MeshBrep(
    Brep=loft,
    Settings={GridMaxCount=0, GridMinCount=16, JaggedSeams=False, MaxEdgeLength=0, MinEdgeLength=0.0001, MinTolerance=0, Refine=True, RefineAngle=0, RelativeTolerance=0.65, SimplePlanes=True, Tolerance=0})
medges = MeshEdges(Mesh=mesh)  # -> NakedEdges, InteriorEdges, NonManifoldEdges
faceb = FaceBoundaries(Mesh=mesh)
boundary = BoundarySurfaces(Edges=project)
demesh = DeconstructMesh(Mesh=mesh)  # -> Vertices, Faces, Colours, Normals
area = Area(Geometry=loft)  # -> Area, Centroid
num = Number(0)
mesh_2 = MeshBrep(
    Brep=boundary,
    Settings={GridMaxCount=0, GridMinCount=16, JaggedSeams=False, MaxEdgeLength=0, MinEdgeLength=0.0001, MinTolerance=0, Refine=True, RefineAngle=0, RelativeTolerance=0.65, SimplePlanes=True, Tolerance=0})
panel = Panel(demesh.Vertices)
python = GhPythonScript(surface=loft, surfaceArea=area.Area, mesh=mesh_2, testFitness=num)  # -> out, mesh; inputs mesh: Mesh
# ---------- python: Python ----------
__author__ = "asus"
__version__ = "2019.08.31"

import rhinoscriptsyntax as rs
import Rhino
import scriptcontext
import System.Guid
import random
import math
from scriptcontext import *
from Rhino.Geometry import *

def move():
    direction = random.randint(1, 3)
    moveLength = random.uniform(-0.5, 0.5)
    if direction == 1:
        v.X += moveLength
    elif direction == 2:
        v.Y += moveLength
    elif direction == 3:
        v.Z += moveLength
    vertices.SetVertex(vertex,v)
    f = fitness(moveLength, direction)
    changes.append([vertex, moveLength, (1/f), direction])
    return

def fitness(moveLength, direction):
    p = pOfFaces()
    proj = project()
    if direction == 1:
        v.X -= moveLength
    elif direction == 2:
        v.Y -= moveLength
    elif direction == 3:
        v.Z -= moveLength
    vertices.SetVertex(vertex,v)
    if proj == -1:
        f = -1
    else:
        f = p * proj
    return f
    
def pOfFaces(): # for triangles and quads
    p = 0
    for i in range(0, mesh.Faces.TriangleCount):
        for j in range(0, 3):
            pt1 = mesh.Vertices[mesh.Faces[i][j]]
            if j == 2:
                pt2 = mesh.Vertices[mesh.Faces[i][0]]
            else:
                pt2 = mesh.Vertices[mesh.Faces[i][j+1]]
            p += math.sqrt((pt1.X - pt2.X) ** 2 + (pt1.Y - pt2.Y) ** 2 + (pt1.Z - pt2.Z) ** 2)
    for i in range(0, mesh.Faces.QuadCount):
        for j in range(0, 4):
            pt1 = mesh.Vertices[mesh.Faces[i][j]]
            if j == 3:
                pt2 = mesh.Vertices[mesh.Faces[i][0]]
            else:
                pt2 = mesh.Vertices[mesh.Faces[i][j+1]]
            p += math.sqrt((pt1.X - pt2.X) ** 2 + (pt1.Y - pt2.Y) ** 2 + (pt1.Z - pt2.Z) ** 2)
    return p

def project():
    surfaceBrep = Rhino.Geometry.BrepFace.ToBrep(mainSurface)
    l = []
    l.append(surfaceBrep)
    points = []
    for i in range(0, mesh.Vertices.Count-1):
        points.append(Point3d(mesh.Vertices[i]))
    pts = Intersect.Intersection.ProjectPointsToBreps(l, points, Vector3d(0, 0, 1), doc.ModelAbsoluteTolerance)
    
    proj = 1
    if len(points) == len(pts):
        for i in range(0, mesh.Vertices.Count-1):
            proj *= (abs(points[i].Z - pts[i].Z) + 1)
    else:
        proj = -1
    return proj

"""
a = Rhino.Geometry.AreaMassProperties.Compute(mesh)
print(a)
"""

def comparison():
    max = -1
    index = -1
    for i in range(0, len(changes)):
        if changes[i][2] == -1:
            continue
        if changes[i][2] > max:
            max = changes[i][2]
            index = i 
    lastFitness = max
    v = mesh.Vertices[changes[index][0]]
    if index != -1:
        if changes[index][3] == 1:
            v.X += changes[index][1]
        elif changes[index][3] == 2:
            v.Y += changes[index][1]
        elif changes[index][3] == 3:
            v.Z += changes[index][1]
        vertices.SetVertex(changes[index][0],v)
    return lastFitness

mainSurface = rs.coercesurface(surface)

lastFitness = 0
counter = 0
while True:
    counter += 1
    changes = []
    for i in range(0, 10):
        vertices = mesh.Vertices
        vertex = random.randint(0, mesh.Vertices.Count - 1)
        direction = random.randint(1, 3)
        v = mesh.Vertices[vertex]
        moveLength = move()
    lastFitness = comparison()
    
    if lastFitness >= testFitness:
        print(counter)
        print(lastFitness)
        break
    if lastFitness == -1:
        print("Failed")
        break
# ---------- end python ----------
panel_2 = Panel(mesh_2)
demesh_2 = DeconstructMesh(Mesh=mesh_2)  # -> Vertices, Faces, Colours, Normals
conmesh = ConstructMesh(Vertices=demesh.Vertices, Faces=demesh.Faces, Colours=demesh.Colours)
panel_3 = Panel(python.out)
medges_2 = MeshEdges(Mesh=conmesh)  # -> NakedEdges, InteriorEdges, NonManifoldEdges
faceb_2 = FaceBoundaries(Mesh=conmesh)
conmesh_2 = ConstructMesh(Vertices=demesh_2.Vertices, Faces=demesh_2.Faces, Colours=demesh_2.Colours)
medges_3 = MeshEdges(Mesh=python.mesh)  # -> NakedEdges, InteriorEdges, NonManifoldEdges
faceb_3 = FaceBoundaries(Mesh=python.mesh)
panel_4 = Panel(demesh_2.Vertices)
medges_4 = MeshEdges(Mesh=conmesh_2)  # -> NakedEdges, InteriorEdges, NonManifoldEdges
faceb_4 = FaceBoundaries(Mesh=conmesh_2)
